# Grasshopper definition xBox.gh (Grasshopper 1.0.8)

number_slider = Slider(0.038, range=0..0.5)
number_slider_2 = Slider(0.009, range=0..0.5)

# ----
# Works
toggle = BooleanToggle(False)
c_analog_value = CSharpScript(STATUS=Button())  # -> out, A, B; inputs STATUS: Boolean; disabled
# ---------- c_analog_value: C# ----------
using System;
using System.Linq;
using System.Collections;
using System.Collections.Generic;
using System.Drawing;

using Rhino;
using Rhino.Geometry;

using Grasshopper;
using Grasshopper.Kernel;
using Grasshopper.Kernel.Data;
using Grasshopper.Kernel.Types;

using System.Threading;
using SharpDX.XInput;

#r "nuget: SharpDX, 4.2.0"
#r "nuget: SharpDX.XInput, 4.2.0"

public class Script_Instance : GH_ScriptInstance
{
    double deadzone = 0.1;

    private void RunScript(bool STATUS, ref object A, ref object B)
    {
        Controller controller = new Controller(UserIndex.One);

        var state = controller.GetState();

        Gamepad pad = state.Gamepad;

        short rx = pad.RightThumbX;
        short ry = pad.RightThumbY;

        double normX = rx / 32767.0;
        double normY = ry / 32767.0;

        normX = Math.Clamp(normX,-1,1);
        normY = Math.Clamp(normY,-1,1);


        string valX,valY;

        if (Math.Abs(normX) < deadzone || Math.Abs(normY) < deadzone)
        {
            valX = "DEADZONE";
            valY = "DEADZONE";
        }else
        {
            valX = normX.ToString();
            valY = normY.ToString();
        }
        

        A = valX;
        B = valY;
    }
}
# ---------- end c_analog_value ----------
c_cross = CSharpScript(STATUS=toggle)  # -> out, A; inputs STATUS: Boolean; disabled
# ---------- c_cross: C# ----------
using System;
using System.Linq;
using System.Collections;
using System.Collections.Generic;
using System.Drawing;

using Rhino;
using Rhino.Geometry;

using Grasshopper;
using Grasshopper.Kernel;
using Grasshopper.Kernel.Data;
using Grasshopper.Kernel.Types;

using System.Threading;
using SharpDX.XInput;

#r "nuget: SharpDX, 4.2.0"
#r "nuget: SharpDX.XInput, 4.2.0"

public class Script_Instance : GH_ScriptInstance
{

// These two fields remain persistent between component updates.
private bool continueLoop = false;

private void RunScript(bool STATUS, ref object A)
{
    Controller controller = new Controller(UserIndex.One);
    // Start the background task if STATUS is true and the task isn't already running.
       if (STATUS && !continueLoop)
    {
        continueLoop = true;

        // Start the background task.
        System.Threading.Tasks.Task.Run(() =>
        {
            Controller controller = new Controller(UserIndex.One);
            while (continueLoop)
            {
                if (controller.IsConnected)
                {
                    var state = controller.GetState();

                    // Check the DPad buttons.
                    bool dUp = (state.Gamepad.Buttons & GamepadButtonFlags.DPadUp) == GamepadButtonFlags.DPadUp;
                    bool dDown = (state.Gamepad.Buttons & GamepadButtonFlags.DPadDown) == GamepadButtonFlags.DPadDown;
                    bool dLeft = (state.Gamepad.Buttons & GamepadButtonFlags.DPadLeft) == GamepadButtonFlags.DPadLeft;
                    bool dRight = (state.Gamepad.Buttons & GamepadButtonFlags.DPadRight) == GamepadButtonFlags.DPadRight;

                    if (dUp || dDown || dLeft || dRight)
                    {
                        // Update the camera on the UI thread.
                        Rhino.RhinoApp.InvokeOnUiThread((Action)(() =>
                        {
                            var view = RhinoDoc.ActiveDoc.Views.ActiveView;
                            if (view != null)
                            {
                                var vp = view.ActiveViewport;
                                Point3d camLoc = vp.CameraLocation;
                                Point3d camTarget = vp.CameraTarget;

                                // Compute a horizontal forward vector (project camera direction on the XY plane)
                                Vector3d forward = camTarget - camLoc;
                                forward.Z = 0;
                                if (forward.Length == 0)
                                    forward = new Vector3d(0, 1, 0);
                                forward.Unitize();

                                // Compute the right vector as the cross of forward and world up (0,0,1)
                                Vector3d right = Vector3d.CrossProduct(forward, Vector3d.ZAxis);
                                if (right.Length == 0)
                                    right = new Vector3d(1, 0, 0);
                                right.Unitize();

                                // Build the translation vector based on the pressed DPad buttons.
                                Vector3d move = Vector3d.Zero;
                                double moveStep = 5.0; // Adjust this value for desired speed

                                if (dUp) move += forward;
                                if (dDown) move -= forward;
                                if (dRight) move += right;
                                if (dLeft) move -= right;
                                move *= moveStep;

                                // Apply the translation to both camera location and target.
                                vp.SetCameraLocation(camLoc + move, false);
                                vp.SetCameraTarget(camTarget + move, false);
                                view.Redraw();
                            }
                        }));
                    }
                }
                Thread.Sleep(20); // Pause briefly to reduce CPU usage and control update speed.
            }
        });
    }
    else if (!STATUS) // If STATUS is false, signal the task to stop.
        continueLoop = false;
    }
}
# ---------- end c_cross ----------
panel = Panel(c_cross.A)
panel_2 = Panel(c_analog_value.B)
panel_3 = Panel(c_analog_value.A)

c_task_yaw_pitch = CSharpScript(
    run=Toggle(False),
    yawSensitivity=number_slider,
    pitchSensitivity=number_slider,
    deadzone=Slider(0.1397, range=0.0001..1),
    moveSpeed=Slider(108, range=0..300))  # -> out, a; inputs run: Boolean, yawSensitivity: Double, pitchSensitivity: Double, deadzone: Double, moveSpeed: Double; disabled
# ---------- c_task_yaw_pitch: C# ----------
using System;
using System.Collections.Generic;
using System.Threading;
using System.Threading.Tasks;
using SharpDX.XInput;

using Rhino;
using Rhino.Geometry;
using Rhino.Display;

using Grasshopper;
using Grasshopper.Kernel;
using Grasshopper.Kernel.Data;
using Grasshopper.Kernel.Types;

#r "nuget: SharpDX, 4.2.0"
#r "nuget: SharpDX.XInput, 4.2.0"

public class Script_Instance : GH_ScriptInstance
{    
    private static CancellationTokenSource _cts;
    private static Status _status = Status.NotInitialized; 
    private List<int> _log;
    double _yawSensitivity,_pitchSensitivity,_deadzone,_moveSpeed;

    public enum Status
    {
        NotInitialized =0,
        Started =1,
        Stopped =2
    }

    private void RunScript(
		bool run,
		double yawSensitivity,
		double pitchSensitivity,
		double deadzone,
		double moveSpeed,
		ref object a)
    {

        _yawSensitivity =yawSensitivity; 
        _pitchSensitivity =pitchSensitivity;
        _deadzone = deadzone;
        _moveSpeed =moveSpeed;

        if(_status == Status.NotInitialized && run)
        {
            Initialize();
            Start();
        } else if (_status == Status.Stopped && run)
            Start();
        else if (_status == Status.Started && !run)
            Stop();

        a= _log;
    }

    (double x, double y) NormalizeStickInput(short rx, short ry)
    {
        double normX = rx / 32767.0;
        double normY = ry / 32767.0;

        normX = Math.Clamp(normX,-1,1);
        normY = Math.Clamp(normY,-1,1);

        double magnitude = Math.Sqrt(normX * normX + normY * normY);

        double deadzoneFixed = (magnitude - _deadzone) / (1 - _deadzone);
        deadzoneFixed = Math.Clamp(deadzoneFixed, 0, 1);

        // Final scaled input
        double finalX = normX / magnitude * deadzoneFixed;
        double finalY = normY / magnitude * deadzoneFixed;

        double yawAngle = -finalX * _yawSensitivity;
        double pitchAngle = finalY * _pitchSensitivity;  

        if  (magnitude < _deadzone)
            return (0, 0);

        return (yawAngle, pitchAngle);
    }

    void MoveCameraFlyMode(RhinoViewport vp, double forwardInput, double strafeInput)
    {
        Vector3d camDir = vp.CameraDirection;
        if (camDir.Length < Rhino.RhinoMath.ZeroTolerance)
            camDir = new Vector3d(0, 1, 0);
        camDir.Unitize();

        Vector3d right = Vector3d.CrossProduct(camDir, vp.CameraUp);
        if (right.Length < Rhino.RhinoMath.ZeroTolerance)
            right = new Vector3d(1, 0, 0);
        right.Unitize();

        Vector3d move = camDir * forwardInput * _moveSpeed + right * strafeInput * _moveSpeed;

        vp.SetCameraLocation(vp.CameraLocation + move,true);
    }

    void RotateCameraFlyMode(RhinoViewport vp, double yawInput, double pitchInput)
    {
        // Get the current camera direction
        Vector3d camDir = vp.CameraDirection;
        if (camDir.Length < Rhino.RhinoMath.ZeroTolerance)
            camDir = new Vector3d(0, 1, 0);
        camDir.Unitize();

        // Yaw (rotate around world Z)
        Transform yawTransform = Transform.Rotation(yawInput , Vector3d.ZAxis, Point3d.Origin);
        camDir.Transform(yawTransform);

        // Pitch (rotate around camera's right vector)
        Vector3d right = Vector3d.CrossProduct(camDir, Vector3d.ZAxis);
        if (right.Length < Rhino.RhinoMath.ZeroTolerance)
            right = new Vector3d(1, 0, 0);
        right.Unitize();

        Transform pitchTransform = Transform.Rotation(pitchInput, right, Point3d.Origin);
        camDir.Transform(pitchTransform);

        vp.SetCameraDirection(camDir, true);
    }

    void Initialize()
    {
        _log = new List<int>();
    }

    async Task  Loop( CancellationToken token)
    {
        Controller controller = new Controller(UserIndex.One);
        
        while (!token.IsCancellationRequested)
        {  
            if (controller.IsConnected)
            {
                var state = controller.GetState();

                Gamepad pad = state.Gamepad;

                (double yawInput,double pitchInput)= NormalizeStickInput(pad.RightThumbX, pad.RightThumbY);
                (double strafeInput,double forwardInput)= NormalizeStickInput(pad.LeftThumbX, pad.LeftThumbY);

                // Update the camera on the UI thread.
                Rhino.RhinoApp.InvokeOnUiThread((Action)(() =>
                {
                    var view = RhinoDoc.ActiveDoc.Views.ActiveView;
                    var vp = view.ActiveViewport;

                    bool redraw = false;
                        if (view != null && (yawInput!=0|| pitchInput!=0))
                        {
                            RotateCameraFlyMode(vp,  yawInput,  pitchInput);
                            redraw =true;
                        }

                        if (view != null && (strafeInput!=0|| forwardInput!=0))
                        {
                            MoveCameraFlyMode(vp, forwardInput, -strafeInput);
                            redraw =true;
                        }

                        if  (redraw)
                            view.Redraw();
                }));
            }

            await Task.Delay(10, token);
        }
    }

    void Stop()
    {
        _cts.Cancel();
        _status = Status.Stopped;
    }

    void Start()
    {
        _cts = new CancellationTokenSource();
        _ = Task.Run(() => Loop(_cts.Token), _cts.Token);
        _status = Status.Started;
    }

    void ExpireSolution()
    {
        // Credit: David Rutten, Eric Anastas
        // https://www.grasshopper3d.com/forum/topics/triggering-solution-refresh?overrideMobileRedirect=1&id=2985220%3ATopic%3A170034&page=1
        var expireAction = new Action<bool>(this.Component.ExpireSolution);

        Grasshopper.Instances.ActiveCanvas.Invoke(expireAction, new object[] { true });
        //The Action has to be invoked, because this method is called by the worker thread and not the mainthread
    }  
}
# ---------- end c_task_yaw_pitch ----------
c_change_speed = CSharpScript(
    run=Toggle(False),
    yawSensitivity=number_slider_2,
    pitchSensitivity=number_slider_2,
    deadzone=Slider(0.1689, range=0.0001..1),
    moveSpeed=Slider(146, range=0..300))  # -> out, a; inputs run: Boolean, yawSensitivity: Double, pitchSensitivity: Double, deadzone: Double, moveSpeed: Double
# ---------- c_change_speed: C# ----------
#r "nuget: SharpDX, 4.2.0"
#r "nuget: SharpDX.XInput, 4.2.0"

using System;
using System.Collections.Generic;
using System.Threading;
using System.Threading.Tasks;
using SharpDX.XInput;

using Rhino;
using Rhino.Geometry;
using Rhino.Display;

public class Script_Instance : GH_ScriptInstance
{    
    private static CancellationTokenSource _cts;
    private static Status _status = Status.NotInitialized; 
    private List<int> _log;
    double _yawSensitivity,_pitchSensitivity,_deadzone,_moveSpeed;

    //Buttons
    private DateTime _lastPressedTime;
    private string _displayMessage = "";

    public enum Status
    {
        NotInitialized =0,
        Started =1,
        Stopped =2
    }

    #region COMPONENT

    private void RunScript(
		bool run,
		double yawSensitivity,
		double pitchSensitivity,
		double deadzone,
		double moveSpeed,
		ref object a)
        {
        _yawSensitivity =yawSensitivity; 
        _pitchSensitivity =pitchSensitivity;
        _deadzone = deadzone;
        _moveSpeed =moveSpeed;

        if(_status == Status.NotInitialized && run)
        {
            Initialize();
            Start();
        } else if (_status == Status.Stopped && run)
            Start();
        else if (_status == Status.Started && !run)
            Stop();

        a= _log;
    }

    void Initialize()
    {
        _log = new List<int>();

        RhinoApp.Closing += (sender, e) =>{SaveSettings();};

        LoadSettings();
    }

    void Start()
    {
        _cts = new CancellationTokenSource();
        _ = Task.Run(() => Loop(_cts.Token), _cts.Token);
        _status = Status.Started;

        Rhino.Display.DisplayPipeline.DrawForeground += DrawText;    
    }

    void Stop()
    {
        _cts.Cancel();
        _status = Status.Stopped;

        Rhino.Display.DisplayPipeline.DrawForeground -= DrawText;  
    }

    void ExpireSolution()
    {
       var expireAction = new Action<bool>(this.Component.ExpireSolution);
        Grasshopper.Instances.ActiveCanvas.Invoke(expireAction, new object[] { true });
    } 

    #endregion

    #region DISPLAY
    void DrawText(object sender, Rhino.Display.DrawEventArgs e)
    {
        var activeView = Rhino.RhinoDoc.ActiveDoc.Views.ActiveView;
        if (e.Viewport.Id != activeView.MainViewport.Id)
            return;

        var screenPoint = new Point2d(50, 50);
        e.Display.Draw2dText(_displayMessage, System.Drawing.Color.Black, screenPoint, false, 25);
    }
    #endregion 

    #region LOOP
    async Task  Loop( CancellationToken token)
    {
        Controller controller = new Controller(UserIndex.One);
        RhinoDoc doc =RhinoDoc.ActiveDoc; 
        
        while (!token.IsCancellationRequested)
        {  
            if (!controller.IsConnected)
            {
                await Task.Delay(1000, token);
                continue;
            }

            var pad = controller.GetState().Gamepad;

            bool l3 = (pad.Buttons & GamepadButtonFlags.LeftThumb) != 0;
            bool r3 = (pad.Buttons & GamepadButtonFlags.RightThumb) != 0;

            //LastPressed
            if (l3 || r3)
            {
                _displayMessage = "BOOSTER";
                _lastPressedTime = DateTime.Now;
            }

            // Apply speed multiplier if active
            double speed = l3 ? 3 * _moveSpeed : _moveSpeed;
            double rotSpeed = r3? 3 : 1;

             // Triggers for vertical movement
            double vertical =   GetNonLinearTrigger(pad.RightTrigger / 255.0) -
                                GetNonLinearTrigger(pad.LeftTrigger / 255.0);

            // Calculate input
            (double yaw,double pitch)= NormalizeStickInput(pad.RightThumbX, pad.RightThumbY);
            (double strafe,double forward)= NormalizeStickInput(pad.LeftThumbX, pad.LeftThumbY);

            // Update the camera on the UI thread.
            Rhino.RhinoApp.InvokeOnUiThread((Action)(() =>
            {
                var view = doc.Views.ActiveView;
                var vp = view.ActiveViewport;

                bool redraw = false;

                if (yaw != 0 || pitch != 0 || forward != 0 || strafe != 0 || Math.Abs(vertical) > 0.02)
                {
                    ApplyCameraFlyControls(vp, forward, -strafe, vertical, yaw, pitch, speed, rotSpeed);
                    redraw = true;
                }

                if ((DateTime.Now - _lastPressedTime).TotalSeconds >= 0.5)
                    _displayMessage = "";

                if  (redraw)
                    view.Redraw();
            }));

            await Task.Delay(10, token);
        }
    }
    #endregion

    #region GAMEPAD 
    double GetNonLinearTrigger(double raw)=>  Math.Pow(raw, 2); // quadratic curve 

    void ApplyCameraFlyControls(RhinoViewport vp, double forward, double strafe, double vertical, double yaw, double pitch, double speed, double rotSpeed)
    {
        Vector3d camDir = vp.CameraDirection;

        // Rotation: Yaw around world Z
        camDir.Transform(Transform.Rotation(yaw * rotSpeed, Vector3d.ZAxis, Point3d.Origin));

        // Rotation: Pitch around right vector
        Vector3d right = Vector3d.CrossProduct(camDir, Vector3d.ZAxis);

        camDir.Transform(Transform.Rotation(pitch * rotSpeed, right, Point3d.Origin));
        vp.SetCameraDirection(camDir, true);

        // Recalculate right vector after rotation
        right = Vector3d.CrossProduct(camDir, vp.CameraUp);

        // Movement
        Vector3d move = Vector3d.ZAxis * vertical +
                        camDir * forward * speed +
                        right * strafe * speed;

        vp.SetCameraLocation(vp.CameraLocation + move, true);
    }

    (double x, double y) NormalizeStickInput(short rx, short ry)
    {
        double normX = rx / 32767.0;
        double normY = ry / 32767.0;

        double magnitude = Math.Sqrt(normX * normX + normY * normY);
        if (magnitude < _deadzone)
            return (0, 0);

        double scaled = Math.Clamp((magnitude - _deadzone) / (1 - _deadzone), 0, 1);

        // Normalize direction
        double dirX = normX / magnitude;
        double dirY = normY / magnitude;

        // Apply sensitivity and scale
        double yaw = -dirX * scaled * _yawSensitivity;
        double pitch = dirY * scaled * _pitchSensitivity;

        return (yaw, pitch);
    }
    #endregion

    #region LOAD/SAVE

    void SaveSettings()
    {
        var lines = new List<string>
        {
            _yawSensitivity.ToString(),
            _pitchSensitivity.ToString(),
            _deadzone.ToString(),
            _moveSpeed.ToString()
        };
        System.IO.File.WriteAllLines(settingsPath, lines);
    }

    void LoadSettings()
    {
        if (!System.IO.File.Exists(settingsPath)) return;
        var lines = System.IO.File.ReadAllLines(settingsPath);
        if (lines.Length >= 4)
        {
            _yawSensitivity = double.Parse(lines[0]);
            _pitchSensitivity = double.Parse(lines[1]);
            _deadzone = double.Parse(lines[2]);
            _moveSpeed = double.Parse(lines[3]);
        }
    }

    string settingsPath = System.IO.Path.Combine(Environment.GetFolderPath(Environment.SpecialFolder.ApplicationData), "MyRhinoControllerSettings.txt");

    #endregion
}
# ---------- end c_change_speed ----------
panel_4 = Panel(c_task_yaw_pitch.a)
panel_5 = Panel(c_change_speed.a)
number_slider_3 = Slider(0.037, range=0..0.5)
c_script = CSharpScript(y=Button())  # -> out, a; disabled
# ---------- c_script: C# ----------
// Grasshopper Script Instance
#r "nuget: SharpDX, 4.2.0"
#r "nuget: SharpDX.XInput, 4.2.0"

#region Usings
using System;
using System.Linq;
using System.Collections;
using System.Collections.Generic;
using System.Drawing;

using Rhino;
using Rhino.Geometry;

using Grasshopper;
using Grasshopper.Kernel;
using Grasshopper.Kernel.Data;
using Grasshopper.Kernel.Types;
using SharpDX.XInput;
using System.Timers;
#endregion

public class Script_Instance : GH_ScriptInstance
{
    #region Notes
    /* 
      Members:
        RhinoDoc RhinoDocument
        GH_Document GrasshopperDocument
        IGH_Component Component
        int Iteration

      Methods (Virtual & overridable):
        Print(string text)
        Print(string format, params object[] args)
        Reflect(object obj)
        Reflect(object obj, string method_name)
    */
    #endregion


    private static Controller controller;
    private static Timer timer;
    private static string lastButtonPress = "No input";
    
    // Initialize Controller
    static Script_Instance()
    {
        controller = new Controller(UserIndex.One);
        
        if (!controller.IsConnected)
        {
            lastButtonPress = "Controller not connected.";
        }
        else
        {
            // Create a Timer to check the button states every 100ms
            timer = new Timer(100);
            timer.Elapsed += CheckControllerState;
            timer.Start();
        }
    }

     private static void CheckControllerState(object sender, ElapsedEventArgs e)
    {
        if (!controller.IsConnected)
        {
            lastButtonPress = "Controller disconnected.";
            return;
        }

        State state = controller.GetState();
        var gamepad = state.Gamepad;
        List<string> pressedButtons = new List<string>();

        if ((gamepad.Buttons & GamepadButtonFlags.A) != 0) pressedButtons.Add("A");
        if ((gamepad.Buttons & GamepadButtonFlags.B) != 0) pressedButtons.Add("B");
        if ((gamepad.Buttons & GamepadButtonFlags.X) != 0) pressedButtons.Add("X");
        if ((gamepad.Buttons & GamepadButtonFlags.Y) != 0) pressedButtons.Add("Y");
        if ((gamepad.Buttons & GamepadButtonFlags.Start) != 0) pressedButtons.Add("Start");
        if ((gamepad.Buttons & GamepadButtonFlags.Back) != 0) pressedButtons.Add("Back");
        if ((gamepad.Buttons & GamepadButtonFlags.LeftShoulder) != 0) pressedButtons.Add("Left Shoulder");
        if ((gamepad.Buttons & GamepadButtonFlags.RightShoulder) != 0) pressedButtons.Add("Right Shoulder");
        if ((gamepad.Buttons & GamepadButtonFlags.LeftThumb) != 0) pressedButtons.Add("Left Thumb");
        if ((gamepad.Buttons & GamepadButtonFlags.RightThumb) != 0) pressedButtons.Add("Right Thumb");
        if ((gamepad.Buttons & GamepadButtonFlags.DPadUp) != 0) pressedButtons.Add("DPad Up");
        if ((gamepad.Buttons & GamepadButtonFlags.DPadDown) != 0) pressedButtons.Add("DPad Down");
        if ((gamepad.Buttons & GamepadButtonFlags.DPadLeft) != 0) pressedButtons.Add("DPad Left");
        if ((gamepad.Buttons & GamepadButtonFlags.DPadRight) != 0) pressedButtons.Add("DPad Right");

          lastButtonPress = pressedButtons.Count > 0 ? string.Join(", ", pressedButtons) : "No buttons pressed.";
    }



    private void RunScript(object x, object y, ref object a)
    {
        // Write your logic here
             a= lastButtonPress;
    }
}
# ---------- end c_script ----------
c_script_2 = CSharpScript(STATUS=Toggle(False))  # -> out, A; inputs STATUS: Boolean; disabled
# ---------- c_script_2: C# ----------
using System;
using System.Linq;
using System.Collections;
using System.Collections.Generic;
using System.Drawing;

using Rhino;
using Rhino.Geometry;

using Grasshopper;
using Grasshopper.Kernel;
using Grasshopper.Kernel.Data;
using Grasshopper.Kernel.Types;

using System.Threading;
using SharpDX.XInput;

#r "nuget: SharpDX, 4.2.0"
#r "nuget: SharpDX.XInput, 4.2.0"

public class Script_Instance : GH_ScriptInstance
{

// These two fields remain persistent between component updates.
private bool continueLoop = false;

private void RunScript(bool STATUS, ref object A)
{
    Controller controller = new Controller(UserIndex.One);
    // Start the background task if STATUS is true and the task isn't already running.
    if (STATUS && !continueLoop)
    {
        continueLoop = true;

        System.Threading.Tasks.Task.Run(() =>
        {
            // Sensitivity factors for rotation (adjust as needed)
            double yawSensitivity = 0.0005;   // Horizontal rotation sensitivity
            double pitchSensitivity = 0.0005; // Vertical rotation sensitivity

            // Deadzone threshold to prevent unintentional rotations when the stick is near center.
            short deadzone = 8000;
    

            while (continueLoop)
            {
                // if (!controller.IsConnected)
                // continue;

                var state = controller.GetState();
                short rightX = state.Gamepad.RightThumbX;
                short rightY = state.Gamepad.RightThumbY;

                // Only process input if the right stick is moved outside the deadzone.
                if (Math.Abs(rightX) > deadzone || Math.Abs(rightY) > deadzone)
                {
                    // Normalize stick values to the range [-1,1]
                    double normalizedX = rightX / 32767.0;
                    double normalizedY = rightY / 32767.0;

                    // Compute rotation angles. For pitch, we typically invert the value so that pushing up looks up.
                    double rotationAngleYaw = normalizedX * yawSensitivity;
                    double rotationAnglePitch = -normalizedY * pitchSensitivity;

                    var view = RhinoDoc.ActiveDoc.Views.ActiveView;
                    var viewport = view.ActiveViewport;
                    
                    // Get current camera location and target.
                    Point3d camLoc = viewport.CameraLocation;
                    Point3d camTarget = viewport.CameraTarget;
                    Vector3d camDir = camTarget - camLoc;
                    double distance = camDir.Length;
                    //camDir.Unitize();

                    // Define the world up vector (assumed Z-up in Rhino).
                    Vector3d worldUp = new Vector3d(0, 0, 1);

                    // --- Horizontal (Yaw) Rotation ---
                    // Rotate the camera direction around the world up axis.
                    Transform yawTransform = Transform.Rotation(rotationAngleYaw, worldUp, camLoc);
                    camDir.Transform(yawTransform);

                    // --- Vertical (Pitch) Rotation ---
                    // Compute the camera's right vector from the updated direction.
                    Vector3d camRight = Vector3d.CrossProduct(camDir, worldUp);
                    camRight.Unitize();
                    // Rotate around the camera's right vector.
                    Transform pitchTransform = Transform.Rotation(rotationAnglePitch, camRight, camLoc);
                    camDir.Transform(pitchTransform);

                    // Calculate the new camera target using the rotated direction.
                    Point3d newCamTarget = camLoc + camDir * distance;
                    // Update the camera parameters.
                    viewport.SetCameraLocation(camLoc, false);
                    //viewport.SetCameraLocation(new Point3d(), true);
                    viewport.SetCameraTarget(newCamTarget, false);
                }

                // Sleep briefly to allow for smoother control and reduce CPU usage.
                Thread.Sleep(50);
            }
        });
    }
    else if (!STATUS) // If STATUS is false, signal the task to stop.
        continueLoop = false;
    }
}
# ---------- end c_script_2 ----------
panel_6 = Panel(c_script_2.A)
panel_7 = Panel(c_script.a)
c_yaw_pitch = CSharpScript(
    STATUS=Toggle(False),
    yawSensitivity=number_slider_3,
    pitchSensitivity=number_slider_3,
    deadzone=Slider(0.1664, range=0.0001..1))  # -> out, A; inputs STATUS: Boolean, yawSensitivity: Double, pitchSensitivity: Double, deadzone: Double; disabled
# ---------- c_yaw_pitch: C# ----------
using System;
using System.Linq;
using System.Collections;
using System.Collections.Generic;
using System.Drawing;

using Rhino;
using Rhino.Geometry;

using Grasshopper;
using Grasshopper.Kernel;
using Grasshopper.Kernel.Data;
using Grasshopper.Kernel.Types;

using System.Threading;
using SharpDX.XInput;

#r "nuget: SharpDX, 4.2.0"
#r "nuget: SharpDX.XInput, 4.2.0"

public class Script_Instance : GH_ScriptInstance
{

// These two fields remain persistent between component updates.
private bool continueLoop = false;

private void RunScript(
		bool STATUS,
		double yawSensitivity,
		double pitchSensitivity,
		double deadzone,
		ref object A)
{
    Controller controller = new Controller(UserIndex.One);
    // Start the background task if STATUS is true and the task isn't already running.
       if (STATUS && !continueLoop)
    {
        continueLoop = true;

        // Start the background task.
        System.Threading.Tasks.Task.Run(() =>
        {
            Controller controller = new Controller(UserIndex.One);
            while (continueLoop)
            {
                if (controller.IsConnected)
                {
                    var state = controller.GetState();


                    Gamepad pad = state.Gamepad;

                    short rx = pad.RightThumbX;
                    short ry = pad.RightThumbY;

                    double normX = rx / 32767.0;
                    double normY = ry / 32767.0;

                    normX = Math.Clamp(normX,-1,1);
                    normY = Math.Clamp(normY,-1,1);

 
                        double yawAngle = -normX * yawSensitivity;
                        double pitchAngle = normY * pitchSensitivity; // invert Y to mimic typical FPS controls


                    if (Math.Abs(normX) < deadzone || Math.Abs(normY) < deadzone)
                    {
                    
                    }else
                    {
                               // Update the camera on the UI thread.
                    Rhino.RhinoApp.InvokeOnUiThread((Action)(() =>
                    {
                     var view = RhinoDoc.ActiveDoc.Views.ActiveView;
                            if (view != null)
                            {
                                var vp = view.ActiveViewport;
                                
                                // Get the current camera direction as a normalized vector.
                                Vector3d camDir = vp.CameraDirection;
                                if (camDir.Length < Rhino.RhinoMath.ZeroTolerance)
                                    camDir = new Vector3d(0, 1, 0);
                                camDir.Unitize();
                                
                                // --- Yaw Rotation ---
                                // Rotate the camera direction around the world up (Z-axis).
                                Transform yawTransform = Transform.Rotation(yawAngle, Vector3d.ZAxis, Point3d.Origin);
                                camDir.Transform(yawTransform);
                                
                                // --- Pitch Rotation ---
                                // Compute the right vector from the updated direction.
                                Vector3d right = Vector3d.CrossProduct(camDir, Vector3d.ZAxis);
                                if (right.Length < Rhino.RhinoMath.ZeroTolerance)
                                    right = new Vector3d(1, 0, 0);
                                right.Unitize();
                                Transform pitchTransform = Transform.Rotation(pitchAngle, right, Point3d.Origin);
                                camDir.Transform(pitchTransform);
                                
                                // Set the updated camera direction.
                                vp.SetCameraDirection(camDir, true);
                                view.Redraw();
                            }
                    }));
                    }
         
            

                }
                Thread.Sleep(20); // Pause briefly to reduce CPU usage and control update speed.
            }
        });
    }
    else if (!STATUS) // If STATUS is false, signal the task to stop.
        continueLoop = false;
    }
}
# ---------- end c_yaw_pitch ----------
number_slider_4 = Slider(0.037, range=0..0.5)
number_slider_5 = Slider(0.037, range=0..0.5)
number_slider_6 = Slider(0.038, range=0..0.5)
panel_8 = Panel(c_yaw_pitch.A)
c_task_yaw_pitch_2 = CSharpScript(
    run=Toggle(False),
    yawSensitivity=number_slider_4,
    pitchSensitivity=number_slider_4,
    deadzone=Slider(0.1664, range=0.0001..1))  # -> out, a; inputs run: Boolean, yawSensitivity: Double, pitchSensitivity: Double, deadzone: Double; disabled
# ---------- c_task_yaw_pitch_2: C# ----------
using System;
using System.Collections.Generic;
using System.Threading;
using System.Threading.Tasks;
using SharpDX.XInput;

using Rhino;
using Rhino.Geometry;

using Grasshopper;
using Grasshopper.Kernel;
using Grasshopper.Kernel.Data;
using Grasshopper.Kernel.Types;

#r "nuget: SharpDX, 4.2.0"
#r "nuget: SharpDX.XInput, 4.2.0"

public class Script_Instance : GH_ScriptInstance
{    
    private static CancellationTokenSource _cts;
    private static Status _status = Status.NotInitialized; 
    private List<int> _log;

    public enum Status
    {
        NotInitialized =0,
        Started =1,
        Stopped =2
    }

double _yawSensitivity,_pitchSensitivity,_deadzone;

    private void RunScript(
		bool run,
		double yawSensitivity,
		double pitchSensitivity,
		double deadzone,
		ref object a)
    {

        _yawSensitivity =yawSensitivity; 
        _pitchSensitivity =pitchSensitivity;
        _deadzone = deadzone;



        if(_status == Status.NotInitialized && run)
        {
            Initialize();
            Start();
        } else if (_status == Status.Stopped && run)
            Start();
        else if (_status == Status.Started && !run)
            Stop();

        a= _log;
    }

    void Initialize()
    {
        _log = new List<int>();
    }

    async Task  Loop( CancellationToken token)
    {
        Controller controller = new Controller(UserIndex.One);
        
        while (!token.IsCancellationRequested)
        {  

            if (controller.IsConnected)
                {
                    var state = controller.GetState();

                    Gamepad pad = state.Gamepad;

                    short rx = pad.RightThumbX;
                    short ry = pad.RightThumbY;

                    double normX = rx / 32767.0;
                    double normY = ry / 32767.0;

                    normX = Math.Clamp(normX,-1,1);
                    normY = Math.Clamp(normY,-1,1);

 
                        double yawAngle = -normX * _yawSensitivity;
                        double pitchAngle = normY * _pitchSensitivity; // invert Y to mimic typical FPS controls


                    if (Math.Abs(normX) < _deadzone || Math.Abs(normY) < _deadzone)
                    {
                    
                    }else
                    {
                    //            // Update the camera on the UI thread.
                    Rhino.RhinoApp.InvokeOnUiThread((Action)(() =>
                    {
                     var view = RhinoDoc.ActiveDoc.Views.ActiveView;
                            if (view != null)
                            {
                                var vp = view.ActiveViewport;
                                
                                // Get the current camera direction as a normalized vector.
                                Vector3d camDir = vp.CameraDirection;
                                if (camDir.Length < Rhino.RhinoMath.ZeroTolerance)
                                    camDir = new Vector3d(0, 1, 0);
                                camDir.Unitize();
                                
                                // --- Yaw Rotation ---
                                // Rotate the camera direction around the world up (Z-axis).
                                Transform yawTransform = Transform.Rotation(yawAngle, Vector3d.ZAxis, Point3d.Origin);
                                camDir.Transform(yawTransform);
                                
                                // --- Pitch Rotation ---
                                // Compute the right vector from the updated direction.
                                Vector3d right = Vector3d.CrossProduct(camDir, Vector3d.ZAxis);
                                if (right.Length < Rhino.RhinoMath.ZeroTolerance)
                                    right = new Vector3d(1, 0, 0);
                                right.Unitize();
                                Transform pitchTransform = Transform.Rotation(pitchAngle, right, Point3d.Origin);
                                camDir.Transform(pitchTransform);
                                
                                // Set the updated camera direction.
                                vp.SetCameraDirection(camDir, true);
                                view.Redraw();
                            }
                    }));
                     }
         
            

                }

           
            
            await Task.Delay(20, token);

            ExpireSolution();
        }
    }

    void Stop()
    {
        _cts.Cancel();
        _status = Status.Stopped;
    }

    void Start()
    {
        _cts = new CancellationTokenSource();
        _ = Task.Run(() => Loop(_cts.Token), _cts.Token);
        _status = Status.Started;
    }

    void ExpireSolution()
    {
        // Credit: David Rutten, Eric Anastas
        // https://www.grasshopper3d.com/forum/topics/triggering-solution-refresh?overrideMobileRedirect=1&id=2985220%3ATopic%3A170034&page=1
        var expireAction = new Action<bool>(this.Component.ExpireSolution);

        Grasshopper.Instances.ActiveCanvas.Invoke(expireAction, new object[] { true });
        //The Action has to be invoked, because this method is called by the worker thread and not the mainthread
    }  
}
# ---------- end c_task_yaw_pitch_2 ----------
c_task_yaw_pitch_3 = CSharpScript(
    run=Toggle(False),
    yawSensitivity=number_slider_5,
    pitchSensitivity=number_slider_5,
    deadzone=Slider(0.1547, range=0.0001..1))  # -> out, a; inputs run: Boolean, yawSensitivity: Double, pitchSensitivity: Double, deadzone: Double; disabled
# ---------- c_task_yaw_pitch_3: C# ----------
using System;
using System.Collections.Generic;
using System.Threading;
using System.Threading.Tasks;
using SharpDX.XInput;

using Rhino;
using Rhino.Geometry;

using Grasshopper;
using Grasshopper.Kernel;
using Grasshopper.Kernel.Data;
using Grasshopper.Kernel.Types;

#r "nuget: SharpDX, 4.2.0"
#r "nuget: SharpDX.XInput, 4.2.0"

public class Script_Instance : GH_ScriptInstance
{    
    private static CancellationTokenSource _cts;
    private static Status _status = Status.NotInitialized; 
    private List<int> _log;

    public enum Status
    {
        NotInitialized =0,
        Started =1,
        Stopped =2
    }

double _yawSensitivity,_pitchSensitivity,_deadzone;

    private void RunScript(
		bool run,
		double yawSensitivity,
		double pitchSensitivity,
		double deadzone,
		ref object a)
    {

        _yawSensitivity =yawSensitivity; 
        _pitchSensitivity =pitchSensitivity;
        _deadzone = deadzone;



        if(_status == Status.NotInitialized && run)
        {
            Initialize();
            Start();
        } else if (_status == Status.Stopped && run)
            Start();
        else if (_status == Status.Started && !run)
            Stop();

        a= _log;
    }

    void Initialize()
    {
        _log = new List<int>();
    }

    async Task  Loop( CancellationToken token)
    {
        Controller controller = new Controller(UserIndex.One);
        
        while (!token.IsCancellationRequested)
        {  

            if (controller.IsConnected)
                {
                    var state = controller.GetState();

                    Gamepad pad = state.Gamepad;

                    short rx = pad.RightThumbX;
                    short ry = pad.RightThumbY;

                    double normX = rx / 32767.0;
                    double normY = ry / 32767.0;

                    normX = Math.Clamp(normX,-1,1);
                    normY = Math.Clamp(normY,-1,1);

 
                    double yawAngle = -normX * _yawSensitivity;
                    double pitchAngle = normY * _pitchSensitivity; // invert Y to mimic typical FPS controls

                    double magnitude = Math.Sqrt(normX * normX + normY * normY);

                    if (magnitude < _deadzone)
                    {
                    
                    }else
                    {
                    //            // Update the camera on the UI thread.
                    Rhino.RhinoApp.InvokeOnUiThread((Action)(() =>
                    {
                     var view = RhinoDoc.ActiveDoc.Views.ActiveView;
                            if (view != null)
                            {
                                var vp = view.ActiveViewport;
                                
                                // Get the current camera direction as a normalized vector.
                                Vector3d camDir = vp.CameraDirection;
                                if (camDir.Length < Rhino.RhinoMath.ZeroTolerance)
                                    camDir = new Vector3d(0, 1, 0);
                                camDir.Unitize();
                                
                                // --- Yaw Rotation ---
                                // Rotate the camera direction around the world up (Z-axis).
                                Transform yawTransform = Transform.Rotation(yawAngle, Vector3d.ZAxis, Point3d.Origin);
                                camDir.Transform(yawTransform);
                                
                                // --- Pitch Rotation ---
                                // Compute the right vector from the updated direction.
                                Vector3d right = Vector3d.CrossProduct(camDir, Vector3d.ZAxis);
                                if (right.Length < Rhino.RhinoMath.ZeroTolerance)
                                    right = new Vector3d(1, 0, 0);
                                right.Unitize();
                                Transform pitchTransform = Transform.Rotation(pitchAngle, right, Point3d.Origin);
                                camDir.Transform(pitchTransform);
                                
                                // Set the updated camera direction.
                                vp.SetCameraDirection(camDir, true);
                                view.Redraw();
                            }
                    }));
                     }
         
            

                }

           
            
            await Task.Delay(20, token);

            ExpireSolution();
        }
    }

    void Stop()
    {
        _cts.Cancel();
        _status = Status.Stopped;
    }

    void Start()
    {
        _cts = new CancellationTokenSource();
        _ = Task.Run(() => Loop(_cts.Token), _cts.Token);
        _status = Status.Started;
    }

    void ExpireSolution()
    {
        // Credit: David Rutten, Eric Anastas
        // https://www.grasshopper3d.com/forum/topics/triggering-solution-refresh?overrideMobileRedirect=1&id=2985220%3ATopic%3A170034&page=1
        var expireAction = new Action<bool>(this.Component.ExpireSolution);

        Grasshopper.Instances.ActiveCanvas.Invoke(expireAction, new object[] { true });
        //The Action has to be invoked, because this method is called by the worker thread and not the mainthread
    }  
}
# ---------- end c_task_yaw_pitch_3 ----------
c_task_yaw_pitch_4 = CSharpScript(
    run=Toggle(False),
    yawSensitivity=number_slider_6,
    pitchSensitivity=number_slider_6,
    deadzone=Slider(0.1458, range=0.0001..1))  # -> out, a; inputs run: Boolean, yawSensitivity: Double, pitchSensitivity: Double, deadzone: Double; disabled
# ---------- c_task_yaw_pitch_4: C# ----------
using System;
using System.Collections.Generic;
using System.Threading;
using System.Threading.Tasks;
using SharpDX.XInput;

using Rhino;
using Rhino.Geometry;

using Grasshopper;
using Grasshopper.Kernel;
using Grasshopper.Kernel.Data;
using Grasshopper.Kernel.Types;

#r "nuget: SharpDX, 4.2.0"
#r "nuget: SharpDX.XInput, 4.2.0"

public class Script_Instance : GH_ScriptInstance
{    
    private static CancellationTokenSource _cts;
    private static Status _status = Status.NotInitialized; 
    private List<int> _log;

    public enum Status
    {
        NotInitialized =0,
        Started =1,
        Stopped =2
    }

double _yawSensitivity,_pitchSensitivity,_deadzone;

    private void RunScript(
		bool run,
		double yawSensitivity,
		double pitchSensitivity,
		double deadzone,
		ref object a)
    {

        _yawSensitivity =yawSensitivity; 
        _pitchSensitivity =pitchSensitivity;
        _deadzone = deadzone;



        if(_status == Status.NotInitialized && run)
        {
            Initialize();
            Start();
        } else if (_status == Status.Stopped && run)
            Start();
        else if (_status == Status.Started && !run)
            Stop();

        a= _log;
    }

    void Initialize()
    {
        _log = new List<int>();
    }

    async Task  Loop( CancellationToken token)
    {
        Controller controller = new Controller(UserIndex.One);
        
        while (!token.IsCancellationRequested)
        {  

            if (controller.IsConnected)
                {
                    var state = controller.GetState();

                    Gamepad pad = state.Gamepad;

                    short rx = pad.RightThumbX;
                    short ry = pad.RightThumbY;

                    double normX = rx / 32767.0;
                    double normY = ry / 32767.0;

                    normX = Math.Clamp(normX,-1,1);
                    normY = Math.Clamp(normY,-1,1);

                    double magnitude = Math.Sqrt(normX * normX + normY * normY);

                    double deadzoneFixed = (magnitude - _deadzone) / (1 - _deadzone);
                    deadzoneFixed = Math.Clamp(deadzoneFixed, 0, 1);

                    // Normalize vector
                    double directionX = normX / magnitude;
                    double directionY = normY / magnitude;

                    // Final scaled input
                    double finalX = directionX * deadzoneFixed;
                    double finalY = directionY * deadzoneFixed;

                    double yawAngle = -finalX * _yawSensitivity;
                    double pitchAngle = finalY * _pitchSensitivity;

                  

                    if (magnitude < _deadzone)
                    {
                    
                    }else
                    {
                    //            // Update the camera on the UI thread.
                    Rhino.RhinoApp.InvokeOnUiThread((Action)(() =>
                    {
                     var view = RhinoDoc.ActiveDoc.Views.ActiveView;
                            if (view != null)
                            {
                                var vp = view.ActiveViewport;
                                
                                // Get the current camera direction as a normalized vector.
                                Vector3d camDir = vp.CameraDirection;
                                if (camDir.Length < Rhino.RhinoMath.ZeroTolerance)
                                    camDir = new Vector3d(0, 1, 0);
                                camDir.Unitize();
                                
                                // --- Yaw Rotation ---
                                // Rotate the camera direction around the world up (Z-axis).
                                Transform yawTransform = Transform.Rotation(yawAngle, Vector3d.ZAxis, Point3d.Origin);
                                camDir.Transform(yawTransform);
                                
                                // --- Pitch Rotation ---
                                // Compute the right vector from the updated direction.
                                Vector3d right = Vector3d.CrossProduct(camDir, Vector3d.ZAxis);
                                if (right.Length < Rhino.RhinoMath.ZeroTolerance)
                                    right = new Vector3d(1, 0, 0);
                                right.Unitize();
                                Transform pitchTransform = Transform.Rotation(pitchAngle, right, Point3d.Origin);
                                camDir.Transform(pitchTransform);
                                
                                // Set the updated camera direction.
                                vp.SetCameraDirection(camDir, true);
                                view.Redraw();
                            }
                    }));
                     }
         
            

                }

           
            
            await Task.Delay(10, token);

            ExpireSolution();
        }
    }

    void Stop()
    {
        _cts.Cancel();
        _status = Status.Stopped;
    }

    void Start()
    {
        _cts = new CancellationTokenSource();
        _ = Task.Run(() => Loop(_cts.Token), _cts.Token);
        _status = Status.Started;
    }

    void ExpireSolution()
    {
        // Credit: David Rutten, Eric Anastas
        // https://www.grasshopper3d.com/forum/topics/triggering-solution-refresh?overrideMobileRedirect=1&id=2985220%3ATopic%3A170034&page=1
        var expireAction = new Action<bool>(this.Component.ExpireSolution);

        Grasshopper.Instances.ActiveCanvas.Invoke(expireAction, new object[] { true });
        //The Action has to be invoked, because this method is called by the worker thread and not the mainthread
    }  
}
# ---------- end c_task_yaw_pitch_4 ----------
panel_9 = Panel(c_task_yaw_pitch_2.a)
panel_10 = Panel(c_task_yaw_pitch_3.a)
panel_11 = Panel(c_task_yaw_pitch_4.a)
